# Dynamo custom node ExpectToEqual.dyf (Dynamo 0.9.0.3067)
# category: Testing
# Tests two inputs against eachother, and returns the first if they are equal.

value = Input()
test = Input()
python_script = Python(IN[0]=value, IN[1]=test)
# ---------- python_script.python (11 lines) ----------
import clr
clr.AddReference('ProtoGeometry')
from Autodesk.DesignScript.Geometry import *
#The inputs to this node will be stored as a list in the IN variables.
dataEnteringNode = IN

#Assign your output to the OUT variable.
if IN[0] != IN[1]:
	raise Exception('The input values are not equal')
else:
	OUT = IN[0]
# ----------------------------------------
value_2 = Output(python_script)  # "value"
