# Dynamo custom node FamilyInstance.OriginalHanding.dyf (Dynamo 1.2.1.3083)
# category: Regnstrom.Elements.FamilyInstance.Query
# Returns true if the familyInstance has the same handling in the project as in its rfa file.

familyInstance = Input(familyInstance : FamilyInstance)
python_script = Python(IN[0]=familyInstance)
# ---------- python_script.python (41 lines) ----------
# Copyright(c) 2017, Isak Regnström

# Import Element wrapper extension methods
import clr
clr.AddReference("RevitNodes")
import Revit
clr.ImportExtensions(Revit.Elements)

# Import DocumentManager and TransactionManager
clr.AddReference("RevitServices")
import RevitServices
from RevitServices.Persistence import DocumentManager
from RevitServices.Transactions import TransactionManager
doc = DocumentManager.Instance.CurrentDBDocument

# Import RevitAPI
clr.AddReference("RevitAPI")
import Autodesk
from Autodesk.Revit.DB import *

#import System
#from System.Collections.Generic import *

#import sys
#pyt_path = r'C:\Program Files (x86)\IronPython 2.7\Lib'
#sys.path.append(pyt_path)

#The inputs to this node will be stored as a list in the IN variable.
dataEnteringNode = IN

familyInstance = UnwrapElement(IN[0])

fFlipped = familyInstance.FacingFlipped
hFlipped = familyInstance.HandFlipped

originalFacing = fFlipped == hFlipped

output = originalFacing

#Assign your output to the OUT variable
OUT = output
# ----------------------------------------
bool = Output(python_script)
