# Dynamo custom node Hello World.dyf (Dynamo 1.2.1.3083)
# category: Regnstrom.String.Create
# Hello World

python_script = Python()  # unwired: IN[0]
# ---------- python_script.python (8 lines) ----------
import clr
clr.AddReference('ProtoGeometry')
from Autodesk.DesignScript.Geometry import *
#The inputs to this node will be stored as a list in the IN variables.
dataEnteringNode = IN

#Assign your output to the OUT variable.
OUT = "Hello World"
# ----------------------------------------
OUT = Output(python_script)
