# Dynamo custom node List From Two Item.dyf (Dynamo 1.2.1.3083)
# category: Regnstrom.Core.List.Create
# Creates a list from two items

item1 = Input()
item2 = Input()
python_script = Python(IN[0]=item1, IN[1]=item2)
# ---------- python_script.python (8 lines) ----------
import clr
clr.AddReference('ProtoGeometry')
from Autodesk.DesignScript.Geometry import *
#The inputs to this node will be stored as a list in the IN variables.
dataEnteringNode = IN

#Assign your output to the OUT variable.
OUT = [IN[0], IN[1]]
# ----------------------------------------
list = Output(python_script)
