# Dynamo custom node Regex.Search.dyf (Dynamo 1.2.1.3083)
# category: Regnstrom.RegularExpression.Actions

pattern = Input(pattern : string)
str = Input(str : string)
python_script = Python(IN[0]=pattern, IN[1]=str)
# ---------- python_script.python (20 lines) ----------
import clr
clr.AddReference('ProtoGeometry')
from Autodesk.DesignScript.Geometry import *
#The inputs to this node will be stored as a list in the IN variables.
dataEnteringNode = IN

import re

pattern = IN[0]
string = IN[1]

result = re.search(pattern, string)

output = False

if result != None:
	output = True

#Assign your output to the OUT variable.
OUT = output
# ----------------------------------------
result = Output(python_script)
