# Dynamo custom node Regex.Substitute.dyf (Dynamo 1.2.1.3083)
# category: Regnstrom.RegularExpression.Actions
# Replaces the first match in str. Returns false if there is no match.

pattern = Input(pattern : string)  # Pattern to match
repl = Input(repl : string)  # Replacement string
str = Input(str : string)  # Input string
python_script = Python(IN[0]=pattern, IN[1]=repl, IN[2]=str)
# ---------- python_script.python (21 lines) ----------
import clr
clr.AddReference('ProtoGeometry')
from Autodesk.DesignScript.Geometry import *
#The inputs to this node will be stored as a list in the IN variables.
dataEnteringNode = IN

import re

pattern = IN[0]
repl = IN[1]
string = IN[2]

result = re.search(pattern, string)

output = False

if result != None:
	output = re.sub(pattern, repl, string)

#Assign your output to the OUT variable.
OUT = output
# ----------------------------------------
result = Output(python_script)
