# Dynamo graph ColorAllOfType.dyn (Dynamo 0.9.0.3067)

select_model_element = DSModelElementSelection()  # 1 picked in the model
type = FamilyInstance.Type(select_model_element)
all_elements_of_family_type = ElementsOfFamilyType(type)
watch = Watch(all_elements_of_family_type)
red = Custom[Color.Red]()  # Returns the colour red.
overrideColorInView = Element.OverrideColorInView(element=all_elements_of_family_type, color=red)
