# Dynamo graph ColorBalconyByType.dyn (Dynamo 0.9.1.4062)

categories = Categories("Floors")
all_elements_of_category = ElementsOfCategory(categories)
code_block = CodeBlock { "Balkonglittera"; }
getParameterValueByName = Element.GetParameterValueByName(element=all_elements_of_category, parameterName=code_block)
groupByKey = List.GroupByKey(list=all_elements_of_category, keys=getParameterValueByName)
watch = Watch(groupByKey.groups)
watch_2 = Watch(groupByKey.unique_keys)
overrideColorInView = Element.OverrideColorInView()
ofRepeatedItem = List.OfRepeatedItem()
white = Custom[Color.White]()  # Returns the colour white.
code_block_2 = CodeBlock { 0..255..#3; }
byARGB = Color.ByARGB(r=code_block_2, g=code_block_2, b=code_block_2, lacing=CrossProduct)
flatten = Flatten(byARGB)
count = Count(flatten)
code_block_3 = CodeBlock { 1; }
sub = count - code_block_3
takeItems = List.TakeItems(list=flatten, amount=sub)
shuffle = List.Shuffle(takeItems)
addItemToFront = List.AddItemToFront(item=white, list=shuffle)
count_2 = Count(groupByKey.unique_keys)
takeItems_2 = List.TakeItems(list=addItemToFront, amount=count_2)
count_3 = Count()
map = List.Map(list=groupByKey.groups, f_x=count_3)
combine = List.Combine(ofRepeatedItem, takeItems_2, map)
combine_2 = List.Combine(overrideColorInView, groupByKey.groups, combine)
