# Dynamo graph ColorBalconyByTypeCrazily.dyn (Dynamo 0.9.1.4062)

categories = Categories("Floors")
all_elements_of_category = ElementsOfCategory(categories)
code_block = CodeBlock { "Balkonglittera"; }
getParameterValueByName = Element.GetParameterValueByName(element=all_elements_of_category, parameterName=code_block)
code_block_2 = CodeBlock { 0..255..#12; }
byARGB = Color.ByARGB(r=code_block_2, g=code_block_2, b=code_block_2, lacing=CrossProduct)
flatten = Flatten(byARGB)
shuffle = List.Shuffle(flatten)
count = Count(shuffle)
count_2 = Count(all_elements_of_category)
overrideColorInView = Element.OverrideColorInView()
combine = List.Combine(overrideColorInView, all_elements_of_category, shuffle)
