# Dynamo graph ColorFlipstate.dyn (Dynamo 0.9.0.3067)

get_built_in_parameter = Custom[Get Built In Parameter]()  # This node will take an input of a built in parameter name and element to return that parameters value.
element_name_universal = Custom[Element.Name (Universal)]()  # Gets an element's name (Dynamo's built-in Name nodes don't work for all element types, e.g. worksets...)
code_block = CodeBlock { "OST_Windows"; }
byName = Category.ByName(code_block)
all_elements_of_category = ElementsOfCategory(byName)
watch = Watch(all_elements_of_category)
watch_2 = Watch(all_elements_of_category)
get_host_element = Custom[Get Host Element](hostedElement=watch_2)  # This node will retrieve a host element from hosted element. Ex. feed in door, get wall.
orientation = Custom[Wall.Orientation](wall=get_host_element)  # Gets the orientation of a given wall instance (normal of the exterior face of the wall). Will *not* work for walls hosted on mass faces or in-place walls.
facingOrientation = FamilyInstance.FacingOrientation(watch_2)
dot = Vector.Dot(orientation, facingOrientation)
code_block_2 = CodeBlock(a=dot) { a == 1; }
filterByBoolMask = List.FilterByBoolMask(list=watch_2, mask=code_block_2)
red = Custom[Color.Red]()  # Returns the colour red.
overrideColorInView = Element.OverrideColorInView(element=filterByBoolMask.out, color=red)
watch_3 = Watch()
select_model_elements = DSModelElementsSelection()  # 2 picked in the model
green = Custom[Color.Green]()  # Returns the colour green.
overrideColorInView_2 = Element.OverrideColorInView(element=filterByBoolMask.in, color=green)
