# Dynamo graph IsolateInView.dyn (Dynamo 1.0.0.1180)

boolean = BoolSelector(false)
active_view = Custom[Active View]()  # Selects the current document's active view. Supports more view types than the built-in option. Will be depreciated once the bult in node works with all plan types.
code_block = CodeBlock(yes=boolean, A=active_view) { (yes ? A : null); }
file_path = Filename("\\sestofs010\Projekt\3576\3760165_Tågordningen_1\000_Systemhandling\13-rit\A-proj\Centralfil\Tågordningen_SH_isak.regnstrom@sweco.html")
parse = Custom[ErrorReport.Parse](report=file_path)  # Process a Revit error report (HTML file) and extract the error types, all affected elements and the total number of errors. If you are executing from a document different than the one the error report belongs to, be sure to set "fetch_elements" to false.
watch = Watch(parse.affected_elements)
watch_2 = Watch(parse.unique_errors)
code_block_2 = CodeBlock { 4; }
getItemAtIndex = List.GetItemAtIndex(list=watch_2, index=code_block_2)
eq = parse.error_messages == getItemAtIndex
filterByBoolMask = List.FilterByBoolMask(list=watch, mask=eq)
watch_3 = Watch(filterByBoolMask.in)
temporarilyIsolateInView = Custom[Element.TemporarilyIsolateInView](view=code_block, element=watch_3)  # (Temporarily) isolates elements in the given view
