# Dynamo graph setRelativeElevation.dyn (Dynamo 1.0.0.1180)

categories = Categories("Windows")
all_elements_of_category = ElementsOfCategory(categories)
code_block = CodeBlock { "^GA .*"; }
type = FamilyInstance.Type(all_elements_of_category)
code_block_2 = CodeBlock { "Type Mark"; }
getParameterValueByName = Element.GetParameterValueByName(element=type, parameterName=code_block_2)
matchRegularExpression = Custom[String.MatchRegularExpression](RegEx=code_block, str=getParameterValueByName)  # Determines if a regular expression matches a string (or a list of strings) and returns a boolean value (or a list, depending on the input). The syntax for regular expressions is explained at http://ironpython-test.readthedocs.org/en/latest/howto/regex.html
filterByBoolMask = List.FilterByBoolMask(list=all_elements_of_category, mask=matchRegularExpression)
code_block_3 = CodeBlock { "dyn_SharedElevation"; }
code_block_4 = CodeBlock { "Level"; "Sill Height"; }
getParameterValueByName_2 = Element.GetParameterValueByName(element=filterByBoolMask.in, parameterName=code_block_4.out0)
code_block_5 = CodeBlock { "Elevation"; }
getParameterValueByName_3 = Element.GetParameterValueByName(element=getParameterValueByName_2, parameterName=code_block_5)
getParameterValueByName_4 = Element.GetParameterValueByName(element=filterByBoolMask.in, parameterName=code_block_4.out1)
code_block_6 = CodeBlock(a=getParameterValueByName_4) { Math.Round(a); }
add = getParameterValueByName_3 + code_block_6
setParameterByName = Element.SetParameterByName(element=filterByBoolMask.in, parameterName=code_block_3, value=add)
