# Dynamo graph AddFamilyParameter.dyn (Dynamo 0.9.0.3067)

code_block = CodeBlock { true; }
join = String.Join()
map = List.Map()
code_block_2 = CodeBlock { "Trh "; 1..8; }
string_from_object = FromObject(code_block_2.out1)
concat = String.Concat(code_block_2.out0)
map_2 = List.Map(list=string_from_object, f_x=concat)
code_block_3 = CodeBlock { "Trh 9 Del 1"; "Trh 9 Del 2"; "G1"; "G2"; }
create = List.Create(code_block_3.out0, code_block_3.out1, code_block_3.out2, code_block_3.out3)
join_2 = List.Join(map_2, create)
addFamilyParameter = Custom[AddFamilyParameter]()  # Add a family parameter to the active family document
getFamilyParameters = Custom[GetFamilyParameters]()  # Add a family parameter to the active family document
code_block_4 = CodeBlock { 0; }
getItemAtIndex = List.GetItemAtIndex(list=getFamilyParameters.param, index=code_block_4)
setFamilyParameter = Custom[SetFamilyParameterValue](param=getItemAtIndex)
map_3 = List.Map(list=getFamilyParameters.param)
watch = Watch(getFamilyParameters.name)
