# Dynamo graph servesRoom.dyn (Dynamo 1.0.0.1180)

categories = Categories("Windows")
all_elements_of_category = ElementsOfCategory(categories)
code_block = CodeBlock { "^GA "; }
type = FamilyInstance.Type(all_elements_of_category)
element_name_universal = Custom[Element.Name (Universal)](element=type)  # Gets an element's name (Dynamo's built-in Name nodes don't work for all element types, e.g. worksets...)
matchRegularExpression = Custom[String.MatchRegularExpression](RegEx=code_block, str=element_name_universal)  # Determines if a regular expression matches a string (or a list of strings) and returns a boolean value (or a list, depending on the input). The syntax for regular expressions is explained at http://ironpython-test.readthedocs.org/en/latest/howto/regex.html
filterByBoolMask = List.FilterByBoolMask(list=all_elements_of_category, mask=matchRegularExpression)
code_block_2 = CodeBlock { "dyn_ServesRoom"; }
code_block_3 = CodeBlock { "\d{3}\s?x\s?\d{3}\s*(.*)"; }
filterByBoolMask_2 = List.FilterByBoolMask(list=element_name_universal, mask=matchRegularExpression)
findRegularExpression = Custom[String.FindRegularExpression](RegEx=code_block_3, str=filterByBoolMask_2.in)  # Returns all occurences of a regular expression within a string (or list of strings). The syntax for regular expressions is explained at http://ironpython-test.readthedocs.org/en/latest/howto/regex.html
flatten = Flatten(findRegularExpression)
setParameterByName = Element.SetParameterByName(element=filterByBoolMask.in, parameterName=code_block_2, value=flatten)
code_block_4 = CodeBlock { "Type Mark"; }
