# Dynamo graph wallLegend.dyn (Dynamo 1.0.0.1180)

byCoordinates = Point.ByCoordinates()
family_types = FamilyTypes("Family1:Family1")
views = Custom[Document.Views]()  # Gets all views in the document - except for 3D view templates (as long as this bug is not fixed: https://github.com/DynamoDS/Dynamo/issues/2970)
element_name_universal = Custom[Element.Name (Universal)](element=views)  # Gets an element's name (Dynamo's built-in Name nodes don't work for all element types, e.g. worksets...)
code_block = CodeBlock { "BH - Inv. väggtyper"; }
eq = element_name_universal == code_block
filterByBoolMask = List.FilterByBoolMask(list=views, mask=eq)
code_block_2 = CodeBlock { 0; }
getItemAtIndex = List.GetItemAtIndex(list=filterByBoolMask.in, index=code_block_2)
byPointInView = Custom[FamilyInstance.ByPointInView](point=byCoordinates, familyType=family_types, view=getItemAtIndex)  # Places a family instance at a given point in a given view (e.g. a detail component).
location = Custom[Element.Location]()  # Returns the location of an element as an XYZ (or if it's line-based the start and end point of the line), along with some booleans to help filtering the results. Use this for some element types (e.g. walls or lines) that do not work with the built-in Get Family Instance Location node.
code_block_3 = CodeBlock { 0; }
getItemAtIndex_2 = List.GetItemAtIndex(list=location.points, index=code_block_3)
