# Dynamo graph matchTwoLists.dyn (Dynamo 1.0.0.1180)

code_block = CodeBlock { {"A", "B", "C", "E"}; {"A", "B", "D", "E", "F"}; }
python_script = Python(IN[0]=code_block.out0, IN[1]=code_block.out1)
# ---------- python_script.python (35 lines) ----------
import clr
clr.AddReference('ProtoGeometry')
from Autodesk.DesignScript.Geometry import *
#The inputs to this node will be stored as a list in the IN variables.
dataEnteringNode = IN

list1 = IN[0]
list2 = IN[1]

#Python black magic
output = [[] for i in range(3)]


#This builds the list of matches and the list of items
#in list1 not present in list2
for i in range(len(list1)):
	for j in range(len(list2)):
		tempVal = list1[i]
		if tempVal == list2[j]:
			output[0].append(tempVal)
			tempVal = None
			break
	output[1].append(tempVal)

#This builds the list of items missing from list1
for i in range(len(list2)):
	for j in range(len(list1)):
		tempVal = list2[i]
		if tempVal == list1[j]:
			tempVal = None
			break
	output[2].append(tempVal)

#Assign your output to the OUT variable.
OUT = output
# ----------------------------------------
add = _ + _
python_script_2 = Python(IN[0]=add)
# ---------- python_script_2.python (14 lines) ----------
import clr
clr.AddReference('ProtoGeometry')
from Autodesk.DesignScript.Geometry import *
#The inputs to this node will be stored as a list in the IN variables.
dataEnteringNode = IN

output = []

output.append('type: ' + str(type(IN[0])))
output.append('str: ' + str(IN[0]))
output.append('dir: ' + str(dir(IN[0])))

#Assign your output to the OUT variable.
OUT = output
# ----------------------------------------
watch = Watch(python_script_2)
