# Dynamo graph pkh.dyn (Dynamo 0.9.0.3067)

select_model_element = DSModelElementSelection()
curve = CurveElement.Curve(select_model_element)
code_block = CodeBlock { 360; }
byRevolve = Surface.ByRevolve(curve, arg4=code_block)
code_block_2 = CodeBlock { 5; 380; }
code_block_3 = CodeBlock(end=code_block_2.out1, step=code_block_2.out0) { Point.ByCoordinates(0,0,10..end..#step); }
byOriginNormal = Plane.ByOriginNormal(origin=code_block_3)
intersect = Geometry.Intersect(geometry=byRevolve, other=byOriginNormal)
flatten = Flatten(intersect)
code_block_4 = CodeBlock { 2; 1; }
takeEveryNthItem = List.TakeEveryNthItem(flatten, code_block_4.out0, code_block_4.out1)
code_block_5 = CodeBlock { 2; 0; }
takeEveryNthItem_2 = List.TakeEveryNthItem(flatten, code_block_5.out0, code_block_5.out1)
XY = Plane.XY()
code_block_6 = CodeBlock { 6; }
code_block_7 = CodeBlock(n=code_block_6) { 180/n; }
rotate = Geometry.Rotate(takeEveryNthItem_2, XY, code_block_7)
python_script = Python(IN[0]=takeEveryNthItem, IN[1]=rotate)
# ---------- python_script.python (24 lines) ----------
import clr
clr.AddReference('ProtoGeometry')
from Autodesk.DesignScript.Geometry import *
#The inputs to this node will be stored as a list in the IN variables.
dataEnteringNode = IN

list1=IN[0]
list2=IN[1]

listLength = len(list1) + len(list2)

outList=[]

ind = 0
while ind<listLength:
	if ind%2==0:
		outList.append(list1[ind/2])
	else:
		outList.append(list2[ind/2])
	
	ind = ind+1

#Assign your output to the OUT variable.
OUT = outList
# ----------------------------------------
divideEqually = Curve.DivideEqually(python_script, code_block_6)
endPoint = Curve.EndPoint(divideEqually)
code_block_8 = CodeBlock { {0,1}; }
getItemAtIndex = List.GetItemAtIndex(index=code_block_8)
map = List.Map(list=endPoint, f_x=getItemAtIndex)
python_script_2 = Python(IN[0]=endPoint, IN[1]=map)
# ---------- python_script_2.python (15 lines) ----------
import clr
clr.AddReference('ProtoGeometry')
from Autodesk.DesignScript.Geometry import *
#The inputs to this node will be stored as a list in the IN variables.
dataEnteringNode = IN

outList = []

for i in range(len(IN[0])):
	outList.append(IN[0][i])
	outList[i].extend(IN[1][i])
	

#Assign your output to the OUT variable.
OUT = outList
# ----------------------------------------
python_script_3 = Python(IN[0]=python_script_2, IN[1]=code_block_6)
# ---------- python_script_3.python (27 lines) ----------
import clr
clr.AddReference('ProtoGeometry')
from Autodesk.DesignScript.Geometry import *
#The inputs to this node will be stored as a list in the IN variables.
dataEnteringNode = IN

inputPoints = IN[0]

numberOfLevels = len(IN[0])-1
numberOfPanels = IN[1]+1

pointsList = [[[] for y in range(numberOfPanels)] for x in range(numberOfLevels)]

for i in range(numberOfLevels):
	for j in range(numberOfPanels-1):
		if i%2==0:
			pointsList[i][j].append([inputPoints[i][j], inputPoints[i][j+1], inputPoints[i+1][j]])
			pointsList[i][j].append([inputPoints[i][j+1], inputPoints[i+1][j+1], inputPoints[i+1][j]])
		else:
			pointsList[i][j].append([inputPoints[i][j], inputPoints[i][j+1], inputPoints[i+1][j+1]])
			pointsList[i][j].append([inputPoints[i][j+1], inputPoints[i+1][j+2], inputPoints[i+1][j+1]])
		
#for x in range(numberOfPanels):
	#pointsList[x].append(x)

#Assign your output to the OUT variable.
OUT = pointsList
# ----------------------------------------
family_types = FamilyTypes("Pepparkakspanel:Panel")
byPoints = AdaptiveComponent.ByPoints(arg1=family_types)
map_2 = List.Map(list=python_script_3, f_x=byPoints)
geometry = Element.Geometry(map_2)
code_block_9 = CodeBlock { false; }
clean = List.Clean(list=map_2, preserveIndices=code_block_9)
flatten_2 = Flatten(clean)
code_block_10 = CodeBlock { "d1"; }
getParameterValueByName = Element.GetParameterValueByName(element=flatten_2, parameterName=code_block_10)
code_block_11 = CodeBlock { 5; }
round = Math.Round(number=getParameterValueByName, digits=code_block_11)
sortByKey = SortByKey(flatten_2, round)
code_block_12 = CodeBlock { "d2"; }
getParameterValueByName_2 = Element.GetParameterValueByName(element=flatten_2, parameterName=code_block_12)
code_block_13 = CodeBlock { "d3"; }
getParameterValueByName_3 = Element.GetParameterValueByName(element=flatten_2, parameterName=code_block_13)
create = List.Create(getParameterValueByName, getParameterValueByName_2, getParameterValueByName_3)
transpose = List.Transpose(create)
sum = Math.Sum()
map_3 = List.Map(list=transpose, f_x=sum)
round_2 = Math.Round(number=getParameterValueByName_2, digits=code_block_11)
uniqueItems = List.UniqueItems(round_2)
round_3 = Math.Round(number=getParameterValueByName_3, digits=code_block_11)
uniqueItems_2 = List.UniqueItems(round_3)
code_block_14 = CodeBlock { "Mark"; }
code_block_15 = CodeBlock { "PK "; }
count = Count(flatten_2)
code_block_16 = CodeBlock { 4; }
python_script_4 = Python(IN[0]=code_block_15, IN[1]=count, IN[2]=code_block_16)
# ---------- python_script_4.python (15 lines) ----------
import clr
clr.AddReference('ProtoGeometry')
from Autodesk.DesignScript.Geometry import *
#The inputs to this node will be stored as a list in the IN variables.
dataEnteringNode = IN

outList = []

for x in range(IN[2]):
	for y in range(IN[1]/IN[2]/2):
		outList.append(IN[0] + str(x*2))
		outList.append(IN[0] + str(x*2 + 1))

#Assign your output to the OUT variable.
OUT = outList
# ----------------------------------------
setParameterByName = Element.SetParameterByName(element=flatten_2, parameterName=code_block_14, value=python_script_4)
uniqueItems_3 = List.UniqueItems(round)
code_block_17 = CodeBlock { "PK "; }
python_script_5 = Python(IN[0]=uniqueItems_3, IN[1]=code_block_17)
# ---------- python_script_5.python (13 lines) ----------
import clr
clr.AddReference('ProtoGeometry')
from Autodesk.DesignScript.Geometry import *
#The inputs to this node will be stored as a list in the IN variables.
dataEnteringNode = IN

outList = []

for x in range(len(IN[0])):
	outList.append(IN[1] + str(x))

#Assign your output to the OUT variable.
OUT = outList
# ----------------------------------------
count_2 = Count(round)
count_3 = Count(uniqueItems_3)
div = count_2 / count_3
ofRepeatedItem = List.OfRepeatedItem(amount=div)
map_4 = List.Map(list=python_script_5, f_x=ofRepeatedItem)
flatten_3 = Flatten(map_4)
