# Dynamo graph createDependentViews.dyn (Dynamo 0.9.0.3067)

# group: Get and filter the relevant views by a variable called dyn_Copy. Create a variable with that name in the project and set it to "yes" to select the views you want to copy.
views = Custom[Document.Views]()  # Gets all views in the document - except for 3D view templates (as long as this bug is not fixed: https://github.com/DynamoDS/Dynamo/issues/2970)
code_block = CodeBlock { "dyn_Filter"; }
getParameterValueByName = Element.GetParameterValueByName(element=views, parameterName=code_block)
code_block_2 = CodeBlock { 1; }
eq = getParameterValueByName == code_block_2
filterByBoolMask = List.FilterByBoolMask(list=views, mask=eq)

# group: Sort views in alphabetical order
name = Element.Name(filterByBoolMask.in)
sortByKey = SortByKey(filterByBoolMask.in, name)

# group: Duplicate the views with detailing. If you don't want to preserve detailing, use View.Duplicate in lunchbox. I haven't tested that, but it should work.
duplicateWithDetailing = Custom[View.DuplicateWithDetailing](View_s=sortByKey)  # Duplicates a given view with detailing

# group: Create new names for the views, edit the box "Name Prefix" to select prefix.
code_block_3 = CodeBlock { "View Name"; }
name_prefix = CodeBlock { "SH"; }
getParameterValueByName_2 = Element.GetParameterValueByName(element=sortByKey, parameterName=code_block_3)
code_block_4 = CodeBlock(namePrefix=name_prefix, oldName=getParameterValueByName_2) { namePrefix + " - " + oldName; }

# group: Rename the master views and pass them along the definition.
setParameterByName = Element.SetParameterByName(element=duplicateWithDetailing, parameterName=code_block_3, value=code_block_4)

# group: Get and sort scope boxes
select_model_elements = DSModelElementsSelection()  # 10 picked in the model
name_2 = Element.Name(select_model_elements)
sortByKey_2 = SortByKey(select_model_elements, name_2)

count = Count(sortByKey_2)

# group: Create child views, one per scope box
ofRepeatedItem = List.OfRepeatedItem(item=setParameterByName, amount=count)
duplicateAsDependent = Custom[View.DuplicateAsDependent]()  # Duplicates a given view as a dependent view
map = List.Map(list=ofRepeatedItem, f_x=duplicateAsDependent)

# group: Create names for the child views by adding " - <NAME_OF_SCOPE_BOX>" as a suffix of the master view's name.
transpose = List.Transpose(map)
code_block_5 = CodeBlock { "View Name"; }
getParameterValueByName_3 = Element.GetParameterValueByName(element=ofRepeatedItem, parameterName=code_block_5)
transpose_2 = List.Transpose(getParameterValueByName_3)
name_3 = Element.Name(sortByKey_2)
code_block_6 = CodeBlock(scopeBox=name_3) { " - " + scopeBox; }
python_script = Python(IN[0]=transpose_2, IN[1]=code_block_6)
# ---------- python_script.python (18 lines) ----------
import clr
clr.AddReference('ProtoGeometry')
from Autodesk.DesignScript.Geometry import *
#The inputs to this node will be stored as a list in the IN variables.
dataEnteringNode = IN

numberOfScopeBoxes = len(IN[0])
numberOfPlans = len(IN[0][0])

outNames = []

for i in range(numberOfScopeBoxes):
	outNames.append([])
	for j in range(numberOfPlans):
		outNames[i].append(IN[0][i][j] + IN[1][j])
		
#Assign your output to the OUT variable.
OUT = outNames
# ----------------------------------------

code_block_7 = CodeBlock { "Scope Box"; }

# group: Set name and Scope Box for each view
setParameterByName_2 = Element.SetParameterByName(element=transpose, parameterName=code_block_5, value=python_script)
setParameterByName_3 = Element.SetParameterByName(parameterName=code_block_7, value=sortByKey_2)
map_2 = List.Map(list=transpose, f_x=setParameterByName_3)
