# Dynamo graph createExportViews.dyn (Dynamo 0.9.0.3067)

# group: Get and filter the relevant views by a variable called dyn_Copy. Create a variable with that name in the project and set it to "yes" to select the views you want to copy.
views = Custom[Document.Views]()  # Gets all views in the document - except for 3D view templates (as long as this bug is not fixed: https://github.com/DynamoDS/Dynamo/issues/2970)
code_block = CodeBlock { "dyn_Filter"; }
getParameterValueByName = Element.GetParameterValueByName(element=views, parameterName=code_block)
code_block_2 = CodeBlock { 1; }
eq = getParameterValueByName == code_block_2
filterByBoolMask = List.FilterByBoolMask(list=views, mask=eq)

# group: Sort views in alphabetical order
name = Element.Name(filterByBoolMask.in)
sortByKey = SortByKey(filterByBoolMask.in, name)

duplicateAsDependent = Custom[View.DuplicateAsDependent](View_s=sortByKey)  # Duplicates a given view as a dependent view
code_block_3 = CodeBlock { "View Name"; }

# group: Generate View Names
code_block_4 = CodeBlock { 8; }
count = Count(sortByKey)
code_block_5 = CodeBlock { "A-40-P-00"; }
python_script = Python(IN[0]=code_block_4, IN[1]=count, IN[2]=code_block_5)
# ---------- python_script.python (20 lines) ----------
import clr
clr.AddReference('ProtoGeometry')
from Autodesk.DesignScript.Geometry import *
#The inputs to this node will be stored as a list in the IN variables.
dataEnteringNode = IN

numberOfViews = IN[1]
viewPrefix = IN[2]

outList = []



for i in range(IN[0], IN[0]+numberOfViews):
	viewName = viewPrefix + '{:0>2d}'.format(i)

	outList.append(viewName)

#Assign your output to the OUT variable.
OUT = outList
# ----------------------------------------

# group: Rename the dependent views and pass them along the definition.
setParameterByName = Element.SetParameterByName(element=duplicateAsDependent, parameterName=code_block_3, value=python_script)

code_block_6 = CodeBlock { "Scope Box"; }

# group: Set name and Scope Box for each view
setParameterByName_2 = Element.SetParameterByName(element=duplicateAsDependent, parameterName=code_block_6)

name_2 = Element.Name(filterByBoolMask.in)
watch = Watch(name_2)
watch_2 = Watch(python_script)
code_block_7 = CodeBlock { "None"; }
getParameterValueByName_2 = Element.GetParameterValueByName(element=duplicateAsDependent, parameterName=code_block_6)
watch_3 = Watch(getParameterValueByName_2)
