# Dynamo graph createQuickDependentViews.dyn (Dynamo 0.9.1.4062)

boolean = BoolSelector(false)

# group: Get and filter the relevant views by a variable called dyn_Copy. Create a variable with that name in the project and set it to "yes" to select the views you want to copy.
views = Custom[Document.Views](toggle=boolean)  # Gets all views in the document - except for 3D view templates (as long as this bug is not fixed: https://github.com/DynamoDS/Dynamo/issues/2970)
code_block = CodeBlock { "dyn_Filter"; }
getParameterValueByName = Element.GetParameterValueByName(element=views, parameterName=code_block)
code_block_2 = CodeBlock { 1; }
eq = getParameterValueByName == code_block_2
filterByBoolMask = List.FilterByBoolMask(list=views, mask=eq)

# group: Sort views in alphabetical order
name = Element.Name(filterByBoolMask.in)
sortByKey = List.SortByKey(list=filterByBoolMask.in, keys=name)

code_block_3 = CodeBlock { 9; }
ofRepeatedItem = List.OfRepeatedItem(item=sortByKey.sorted_list, amount=code_block_3)
transpose = List.Transpose(ofRepeatedItem)
