# Dynamo graph createSheetsByDynamo.dyn (Dynamo 0.9.0.3067)

# group: Get and sort scope boxes
select_model_elements = DSModelElementsSelection()  # 10 picked in the model
name = Element.Name(select_model_elements)
sortByKey = SortByKey(select_model_elements, name)

# group: Get and sort scope boxes (for garage)
select_model_elements_2 = DSModelElementsSelection()  # 2 picked in the model
name_2 = Element.Name(select_model_elements_2)
sortByKey_2 = SortByKey(select_model_elements_2, name_2)

join = List.Join(sortByKey.out1, sortByKey_2.out1)

# group: Create Sheet Names and Sheet Numbers
code_block = CodeBlock { "A-40-1-"; }
code_block_2 = CodeBlock { 8; 20; }
python_script = Python(IN[0]=code_block, IN[1]=code_block_2.out0, IN[2]=code_block_2.out1, IN[3]=join)
# ---------- python_script.python (21 lines) ----------
import clr
clr.AddReference('ProtoGeometry')
from Autodesk.DesignScript.Geometry import *
#The inputs to this node will be stored as a list in the IN variables.
dataEnteringNode = IN

prefix = IN[0]

startingLevel = IN[1]
endingLevel = IN[2]

partsNames = IN[3]

outNames = []

for i in range(len(partsNames)):
	for j in range(startingLevel, endingLevel + 1):
		outNames.append(prefix+'{0:02}{1:02}'.format(i+1, j))
		
#Assign your output to the OUT variable.
OUT = outNames
# ----------------------------------------
python_script_2 = Python(IN[0]=join, IN[1]=code_block_2.out0, IN[2]=code_block_2.out1)
# ---------- python_script_2.python (20 lines) ----------
import clr
clr.AddReference('ProtoGeometry')
from Autodesk.DesignScript.Geometry import *
#The inputs to this node will be stored as a list in the IN variables.
dataEnteringNode = IN

prefix = IN[0]

startingLevel = IN[1]
endingLevel = IN[2]

outNames = []

for i in range(len(prefix)):
	for j in range(startingLevel, endingLevel):
		outNames.append(prefix[i]+' - Plan {:02}'.format(j))
	outNames.append(prefix[i]+' - Takplan')
		
#Assign your output to the OUT variable.
OUT = outNames
# ----------------------------------------

# group: Check for duplicate sheets using their Sheet Number
categories = Categories("Sheets")
all_elements_of_category = ElementsOfCategory(categories)
sheetNumber = Sheet.SheetNumber(all_elements_of_category)
containsItem = List.ContainsItem(list=sheetNumber)

# group: in = sheet exists out = sheet does not exist
map = List.Map(list=python_script, f_x=containsItem)
filterByBoolMask = List.FilterByBoolMask(list=python_script, mask=map)
filterByBoolMask_2 = List.FilterByBoolMask(list=python_script_2, mask=map)

# group: Get the already existing sheets, so new don't have to be created
indexOf = IndexOf(sheetNumber)
map_2 = List.Map(list=filterByBoolMask.in, f_x=indexOf)
getItemAtIndex = List.GetItemAtIndex(list=all_elements_of_category)
map_3 = List.Map(list=map_2, f_x=getItemAtIndex)

family_types = FamilyTypes("SVB3 A1 JM:SVB3 A1 JM")

# group: Set this to an empty Drafting view
views = Views("Dummy")

# group: Create new sheets
byNameNumberTitleBlockAndView = Sheet.ByNameNumberTitleBlockAndView(sheetName=filterByBoolMask_2.out, sheetNumber=filterByBoolMask.out, titleBlockFamilyType=family_types, view=views)

join_2 = List.Join(map_3, byNameNumberTitleBlockAndView)
sheetNumber_2 = Sheet.SheetNumber(join_2)
sortByKey_3 = SortByKey(join_2, sheetNumber_2)

# group: Set relevant parameters of the sheets
code_block_3 = CodeBlock { "sweco_BSAB-Kod"; "40.1.3 Delplaner"; }
setParameterByName = Element.SetParameterByName(element=sortByKey_3, parameterName=code_block_3.out0, value=code_block_3.out1)
code_block_4 = CodeBlock { "sweco_Drawing Status"; "SYSTEMHANDLING"; }
setParameterByName_2 = Element.SetParameterByName(element=setParameterByName, parameterName=code_block_4.out0, value=code_block_4.out1)
