# Dynamo graph createSheetsByDynamoNoScopeBoxes.dyn (Dynamo 0.9.1.4062)

code_block = CodeBlock { "TRH"; }
code_block_2 = CodeBlock { 9; 4; }

# group: Create Sheet Names and Sheet Numbers
code_block_3 = CodeBlock { "A-40-1-"; }
code_block_4 = CodeBlock { 8; 20; }

# group: DELPLANER
python_script = Python(IN[0]=code_block, IN[1]=code_block_2.out0, IN[2]=code_block_2.out1)
# ---------- python_script.python (19 lines) ----------
import clr
clr.AddReference('ProtoGeometry')
from Autodesk.DesignScript.Geometry import *
#The inputs to this node will be stored as a list in the IN variables.
dataEnteringNode = IN

prefix = IN[0]

startingLevel = IN[1]
endingLevel = IN[2]

outNames = []

for i in range(1, startingLevel + 1):
	for j in range(1, endingLevel + 1):
		outNames.append(prefix+' {0:01} - {1:01}'.format(i, j))
		
#Assign your output to the OUT variable.
OUT = outNames
# ----------------------------------------
python_script_2 = Python(IN[0]=code_block_3, IN[1]=code_block_2.out0, IN[2]=code_block_2.out1)
# ---------- python_script_2.python (19 lines) ----------
import clr
clr.AddReference('ProtoGeometry')
from Autodesk.DesignScript.Geometry import *
#The inputs to this node will be stored as a list in the IN variables.
dataEnteringNode = IN

prefix = IN[0]

parts = IN[1]
number = IN[2]

outNames = []

for i in range(1, parts+1):
	for j in range(1, number+1):
		outNames.append(prefix+'{0:01}{1:02}'.format(i, j))
		
#Assign your output to the OUT variable.
OUT = outNames
# ----------------------------------------

# group: Check for duplicate sheets using their Sheet Number
categories = Categories("Sheets")
all_elements_of_category = ElementsOfCategory(categories)
sheetNumber = Sheet.SheetNumber(all_elements_of_category)
containsItem = List.ContainsItem(list=sheetNumber)

# group: in = sheet exists out = sheet does not exist
map = List.Map(list=python_script_2, f_x=containsItem)
filterByBoolMask = List.FilterByBoolMask(list=python_script, mask=map)
filterByBoolMask_2 = List.FilterByBoolMask(list=python_script_2, mask=map)

# group: Get the already existing sheets, so new don't have to be created
indexOf = IndexOf(sheetNumber)
map_2 = List.Map(list=filterByBoolMask.in, f_x=indexOf)
getItemAtIndex = List.GetItemAtIndex(list=all_elements_of_category)
map_3 = List.Map(list=map_2, f_x=getItemAtIndex)

family_types = FamilyTypes("SVB3 A1 JM:SVB3 A1 JM")

# group: Set this to an empty Drafting view
views = Views("Dummy")

# group: Create new sheets
byNameNumberTitleBlockAndView = Sheet.ByNameNumberTitleBlockAndView(sheetName=filterByBoolMask_2.out, sheetNumber=filterByBoolMask.out, titleBlockFamilyType=family_types, view=views)

join = List.Join(map_3, byNameNumberTitleBlockAndView)
sheetNumber_2 = Sheet.SheetNumber(join)
sortByKey = List.SortByKey(list=join, keys=sheetNumber_2)

# group: Set relevant parameters of the sheets
code_block_5 = CodeBlock { "sweco_BSAB-Kod"; "40.1.3 Delplaner"; }
setParameterByName = Element.SetParameterByName(element=sortByKey.sorted_list, parameterName=code_block_5.out0, value=code_block_5.out1)
code_block_6 = CodeBlock { "sweco_Drawing Status"; "BYGGLOVSHANDLING"; }
setParameterByName_2 = Element.SetParameterByName(element=setParameterByName, parameterName=code_block_6.out0, value=code_block_6.out1)

code_block_7 = CodeBlock { "PLAN"; }

# group: ÖVERSIKTSPLANER
python_script_3 = Python(IN[0]=code_block_3, IN[1]=code_block_4.out0, IN[2]=code_block_4.out1)
# ---------- python_script_3.python (18 lines) ----------
import clr
clr.AddReference('ProtoGeometry')
from Autodesk.DesignScript.Geometry import *
#The inputs to this node will be stored as a list in the IN variables.
dataEnteringNode = IN

prefix = IN[0]

startingLevel = IN[1]
endingLevel = IN[2]

outNames = []

for i in range(startingLevel, endingLevel + 1):
	outNames.append(prefix+'0{0:02}'.format(i))
		
#Assign your output to the OUT variable.
OUT = outNames
# ----------------------------------------
python_script_4 = Python(IN[0]=code_block_7, IN[1]=code_block_4.out0, IN[2]=code_block_4.out1)
# ---------- python_script_4.python (18 lines) ----------
import clr
clr.AddReference('ProtoGeometry')
from Autodesk.DesignScript.Geometry import *
#The inputs to this node will be stored as a list in the IN variables.
dataEnteringNode = IN

prefix = IN[0]

startingLevel = IN[1]
endingLevel = IN[2]

outNames = []

for i in range(startingLevel, endingLevel + 1):
	outNames.append(prefix+' {0:02}'.format(i))
		
#Assign your output to the OUT variable.
OUT = outNames
# ----------------------------------------

watch = Watch(python_script_2)
watch_2 = Watch(python_script)
