# Dynamo graph createSheetsByExcel.dyn (Dynamo 0.9.0.3067)

categories = Categories("TitleBlocks")

# group: Indata för sheet numbers
prefix = CodeBlock { "A-40.1-"; }
första_plan = CodeBlock { 8; }
antal_plan = CodeBlock { 13; }
antal_delar = CodeBlock { 12; }

python_script = Python(IN[0]=prefix, IN[1]=första_plan, IN[2]=antal_plan, IN[3]=antal_delar)
# ---------- python_script.python (23 lines) ----------
import clr
clr.AddReference('ProtoGeometry')
from Autodesk.DesignScript.Geometry import *
#The inputs to this node will be stored as a list in the IN variables.
dataEnteringNode = IN

prefix = IN[0]

firstFloor = IN[1]
numPlans = IN[2]
numParts = IN[3]

sheetNumbers = []

for i in range(numPlans):
	for j in range(numParts):
		nextSheetNumber = '{0}{1:02}{2:02}'.format(prefix, firstFloor+i, j+1)
		sheetNumbers.append(nextSheetNumber)



#Assign your output to the OUT variable.
OUT = sheetNumbers
# ----------------------------------------
watch = Watch(python_script)
views = Custom[Document.Views]()  # Gets all views in the document - except for 3D view templates (as long as this bug is not fixed: https://github.com/DynamoDS/Dynamo/issues/2970)
watch_2 = Watch(views)

# group: Get Views and filter by regular expressions, view names are output to [0] and a boolean mask to filter with to [1]
code_block = CodeBlock { "View Name"; }
getParameterValueByName = Element.GetParameterValueByName(element=views, parameterName=code_block)
code_block_2 = CodeBlock { "(SH - )(.* -.*)"; }
python_script_2 = Python(IN[0]=getParameterValueByName, IN[1]=code_block_2)
# ---------- python_script_2.python (22 lines) ----------
import clr
import re
clr.AddReference('ProtoGeometry')
from Autodesk.DesignScript.Geometry import *
#The inputs to this node will be stored as a list in the IN variables.
dataEnteringNode = IN

sheetNames = IN[0]
pattern = IN[1]

matches = [[] for x in range(2)]

for i in range(len(sheetNames)):
	m = re.match(pattern, sheetNames[i])
	if m:
		matches[0].append(m.group(2))
		matches[1].append(True)
	else:
		matches[1].append(False)
		
#Assign your output to the OUT variable.
OUT = matches
# ----------------------------------------

code_block_3 = CodeBlock { 1; }
getItemAtIndex = List.GetItemAtIndex(list=python_script_2, index=code_block_3)
filterByBoolMask = List.FilterByBoolMask(list=views, mask=getItemAtIndex)
code_block_4 = CodeBlock { 0; }
getItemAtIndex_2 = List.GetItemAtIndex(list=python_script_2, index=code_block_4)
sortByKey = SortByKey(filterByBoolMask.in, getItemAtIndex_2)
watch_3 = Watch(sortByKey)
file_path = Filename("C:\Users\seregn\dynamo\01_Sheets\CreateSheets.xlsx")
fromPath = FileObject(file_path)  # "File.FromPath"
code_block_5 = CodeBlock { "Blad1"; }
readFromFile = Excel.ReadFromFile(file=fromPath, sheetName=code_block_5)
transpose = List.Transpose(readFromFile)
code_block_6 = CodeBlock { 0; }
getItemAtIndex_3 = List.GetItemAtIndex(list=transpose, index=code_block_6)
removeItemAtIndex = List.RemoveItemAtIndex(list=getItemAtIndex_3, indices=code_block_6)
code_block_7 = CodeBlock { 1; }
getItemAtIndex_4 = List.GetItemAtIndex(list=transpose, index=code_block_7)
removeItemAtIndex_2 = List.RemoveItemAtIndex(list=getItemAtIndex_4, indices=code_block_6)
family_types = FamilyTypes("A1 BH90:A1 BH90")
views_2 = Views("Drafting 1")
byNameNumberTitleBlockAndView = Sheet.ByNameNumberTitleBlockAndView(sheetName=removeItemAtIndex, sheetNumber=removeItemAtIndex_2, titleBlockFamilyType=family_types, view=views_2)
code_block_8 = CodeBlock { "CQ Browser Group"; "Hej"; }
setParameterByName = Element.SetParameterByName(element=byNameNumberTitleBlockAndView, parameterName=code_block_8.out0, value=code_block_8.out1)
