# Dynamo graph findOfigInSheets.dyn (Dynamo 0.9.0.3067)

code_block = CodeBlock { "(A-4\d-\d-(\d{4}))"; }
code_block_2 = CodeBlock { "Ofig_SVB3"; }
byName = FamilyType.ByName(code_block_2)
find_symbol_in_sheets = Custom[Find Symbol In Sheets](RegEx=code_block, Family_Type=byName)  # A node to find all occurances of a given symbol family type. The node will process all sheets with sheet numbers matching the regEx input.

# group: Separate the sheet numbers from the values we'll be using to set the instance parameters of the Ofig family instances
code_block_3 = CodeBlock { 1; }
flatten = List.Flatten(list=find_symbol_in_sheets.seq, amt=code_block_3)
transpose = List.Transpose(flatten)
code_block_4 = CodeBlock(x=transpose) { sheetNumbers = x[0]; planPartInfo = x[1]; }

count = List.Count(code_block_4.sheetNumbers)
count_2 = List.Count(find_symbol_in_sheets.Elements)

# group: Check if there are an equal number of sheets (worksets) as there are Ofigs
python_script = Python(IN[0]=count, IN[1]=count_2)
# ---------- python_script.python (11 lines) ----------
import clr
clr.AddReference('ProtoGeometry')
from Autodesk.DesignScript.Geometry import *
#The inputs to this node will be stored as a list in the IN variables.
dataEnteringNode = IN

#Assign your output to the OUT variable.
if IN[0] != IN[1]:
	raise Exception('The input values are not equal')
else:
	OUT = IN[0]
# ----------------------------------------

uniqueItems = List.UniqueItems(code_block_4.sheetNumbers)
count_3 = List.Count(uniqueItems)

# group: Check if there are an equal number of sheets (worksets) as there are Ofigs
python_script_2 = Python(IN[0]=python_script, IN[1]=count_3)  # same code as python_script

duplicate_item_indices = Custom[Duplicate Item Indices](List=code_block_4.sheetNumbers)  # Searches an input list for duplicate entries and lists their index numbers. Couple with Get From List to delete duplicates from a list.
getItemAtIndex = List.GetItemAtIndex(list=code_block_4.sheetNumbers)
map = List.Map(list=duplicate_item_indices.Duplicate_Indices, f_x=getItemAtIndex)
watch = Watch(map)
code_block_5 = CodeBlock()
# ---------- code_block_5.designscript (14 lines) ----------
{
"Tr 1",
"Tr 2",
"Tr 3",
"Tr 4",
"Tr 5",
"Tr 6",
"Tr 7",
"Tr 8",
"Tr 9 Del 1",
"Tr 9 Del 2",
"G 1",
"G 2"
};
# ----------------------------------------

# group: Clear all values
code_block_6 = CodeBlock { 0; }
setParameterByName = Element.SetParameterByName(parameterName=code_block_5, value=code_block_6, lacing=CrossProduct)

# group: Set all values to yes
code_block_7 = CodeBlock { 1; }
setParameterByName_2 = Element.SetParameterByName(parameterName=code_block_5, value=code_block_7, lacing=CrossProduct)

# group: Part
code_block_8 = CodeBlock { 0; 2; }
substring = String.Substring(str=code_block_4.planPartInfo, startIndex=code_block_8.out0, length=code_block_8.out1)
toNumber = String.ToNumber(substring)

# group: in: 0 out: byggnadsdelens nummer för delplaner
code_block_9 = CodeBlock { 0; }
eq = _ == code_block_9
filter = List.Filter(toNumber, eq)

code_block_10 = CodeBlock(x=filter.out1) { x-1; }
getItemAtIndex_2 = List.GetItemAtIndex(list=code_block_5, index=code_block_10)

# group: Set one value to yes
code_block_11 = CodeBlock { 1; }
setParameterByName_3 = Element.SetParameterByName(parameterName=getItemAtIndex_2, value=code_block_11)

code_block_12 = CodeBlock()
# ---------- code_block_12.designscript (5 lines) ----------
{
"Tr 1-4",
"Tr 5-7",
"Tr 8-9"
};
# ----------------------------------------
code_block_13 = CodeBlock(d=code_block_12) { pref = "Sektion "; pref + d[0]; pref + d[1]; pref + d[2]; }

# group: Clear all values
code_block_14 = CodeBlock { 0; }
setParameterByName_4 = Element.SetParameterByName(parameterName=code_block_13.pref, value=code_block_14, lacing=CrossProduct)

code_block_15 = CodeBlock { 8..19; }
code_block_16 = CodeBlock(n=code_block_15) { "plan " + n; }

# group: Sektionsskrafering, garage
code_block_17 = CodeBlock(d=code_block_12, a=code_block_16) { d[0] + ", " + a[0..1]; }
code_block_18 = CodeBlock(d=code_block_12, a=code_block_16) { d[1] + ", " + a[0..1]; }
code_block_19 = CodeBlock(d=code_block_12, a=code_block_16) { d[2] + ", " + a[0..1]; }

join = List.Join(code_block_17, code_block_18, code_block_19)

# group: Clear all values
code_block_20 = CodeBlock { 0; }
setParameterByName_5 = Element.SetParameterByName(parameterName=join, value=code_block_20, lacing=CrossProduct)

code_block_21 = CodeBlock { "^"; "| översiktsplaner"; "| deplaner"; "v"; }
code_block_22 = CodeBlock { "^"; "| översiktsplaner"; "| deplaner"; "v"; }

# group: Level
code_block_23 = CodeBlock { 2; 2; }
substring_2 = String.Substring(str=code_block_4.planPartInfo, startIndex=code_block_23.out0, length=code_block_23.out1)
toNumber_2 = String.ToNumber(substring_2)

# group: in: planNr i översiktsplaner out: planNr i delplaner
code_block_24 = CodeBlock { 0; }
eq_2 = toNumber == code_block_24
filterByBoolMask = List.FilterByBoolMask(list=toNumber_2, mask=eq_2)

# group: Våningsnummer
watch_2 = Watch(filterByBoolMask.out)

code_block_25 = CodeBlock { 8; }
sub = watch_2 - code_block_25

# group: Byggnadsdel
watch_3 = Watch(filter.out1)

python_script_3 = Python(IN[0]=watch_2, IN[1]=watch_3)
# ---------- python_script_3.python (29 lines) ----------
import clr
clr.AddReference('ProtoGeometry')
from Autodesk.DesignScript.Geometry import *
#The inputs to this node will be stored as a list in the IN variables.
dataEnteringNode = IN

level = IN[0]
part = IN[1]

OUT = []

for i in range(len(level)):

	tempVar = 0
	if 1 <= part[i] <= 4:
		tempVar = 0
	elif 5 <= part[i] <= 7:
		tempVar = 2
	else :
		tempVar = 4
	
	if level[i] == 8:
		OUT.append(tempVar + 0)
	elif level[i] == 9:
		OUT.append(tempVar + 1)
	else :
		OUT.append(None)

#Assign your output to the OUT variable.
# ----------------------------------------
lunchbox_remove_null_values = Custom[LunchBox Remove Null Values](List=python_script_3)  # Remove 'null' values from a list.
getItemAtIndex_3 = List.GetItemAtIndex(list=join, index=lunchbox_remove_null_values)

# group: Set one value to yes
code_block_26 = CodeBlock { 1; }
setParameterByName_6 = Element.SetParameterByName(parameterName=getItemAtIndex_3, value=code_block_26)

categories = Categories("Sheets")
all_elements_of_category = ElementsOfCategory(categories)
sheetNumber = Sheet.SheetNumber(all_elements_of_category)
matchRegularExpression = Custom[String.MatchRegularExpression](RegEx=code_block, str=sheetNumber)  # Determines if a regular expression matches a string (or a list of strings) and returns a boolean value (or a list, depending on the input). The syntax for regular expressions is explained at http://ironpython-test.readthedocs.org/en/latest/howto/regex.html
filterByBoolMask_2 = List.FilterByBoolMask(list=sheetNumber, mask=matchRegularExpression)
count_4 = List.Count(code_block_4.sheetNumbers)
filterByBoolMask_3 = List.FilterByBoolMask(list=all_elements_of_category, mask=matchRegularExpression)
count_5 = List.Count(filterByBoolMask_3.in)

# group: Check if every sheet is matched by a workset from the Ofigs
python_script_4 = Python(IN[0]=count_4, IN[1]=count_5)  # same code as python_script

python_script_5 = Python(IN[0]=watch_2, IN[1]=watch_3)
# ---------- python_script_5.python (22 lines) ----------
import clr
clr.AddReference('ProtoGeometry')
from Autodesk.DesignScript.Geometry import *
#The inputs to this node will be stored as a list in the IN variables.
dataEnteringNode = IN

level = IN[0]
part = IN[1]

OUT = []

for i in range(len(level)):

	if 8 <= part[i] <= 9:
		OUT.append('Tr 8-9, plan ' + str(level[i]))
	elif part[i] == 10:
		OUT.append('Tr 9 Del 2, plan ' + str(level[i]))
	else:
		OUT.append('Tr ' + str(part[i]) + ', plan ' + str(level[i]))
		
		
#Assign your output to the OUT variable.
# ----------------------------------------

# group: Set one value to yes
code_block_27 = CodeBlock { 1; }
setParameterByName_7 = Element.SetParameterByName(parameterName=python_script_5, value=code_block_27)

# group: in: Ofigs i översiktsplaner out: Ofigs i delplaner
code_block_28 = CodeBlock { 0; }
eq_3 = toNumber == code_block_28
filterByBoolMask_4 = List.FilterByBoolMask(list=find_symbol_in_sheets.Elements, mask=eq_3)

watch_4 = Watch(filterByBoolMask_4.out)

# group: Bool mask for tr 1-4
code_block_29 = CodeBlock { 1..4; }
containsItem = List.ContainsItem(item=code_block_29)
map_2 = List.Map(list=watch_3, f_x=containsItem)
anyTrue = Custom[List.AnyTrue]()  # Returns true if any item in a list of booleans is true.
map_3 = List.Map(list=map_2, f_x=anyTrue)

filterByBoolMask_5 = List.FilterByBoolMask(list=watch_4, mask=map_3)
watch_5 = Watch(code_block_13.out1)

# group: Set one value to yes
code_block_30 = CodeBlock { 1; }
setParameterByName_8 = Element.SetParameterByName(parameterName=watch_5, value=code_block_30)

# group: Bool mask for tr 8-9 + garage
code_block_31 = CodeBlock { 8..12; }
containsItem_2 = List.ContainsItem(item=code_block_31)
map_4 = List.Map(list=watch_3, f_x=containsItem_2)
anyTrue_2 = Custom[List.AnyTrue]()
map_5 = List.Map(list=map_4, f_x=anyTrue_2)

filterByBoolMask_6 = List.FilterByBoolMask(list=watch_4, mask=map_5)

# group: Bool mask for tr 5-7
code_block_32 = CodeBlock { 5..7; }
containsItem_3 = List.ContainsItem(item=code_block_32)
map_6 = List.Map(list=watch_3, f_x=containsItem_3)
anyTrue_3 = Custom[List.AnyTrue]()
map_7 = List.Map(list=map_6, f_x=anyTrue_3)

filterByBoolMask_7 = List.FilterByBoolMask(list=watch_4, mask=map_7)
watch_6 = Watch(code_block_13.out2)

# group: Set one value to yes
code_block_33 = CodeBlock { 1; }
setParameterByName_9 = Element.SetParameterByName(parameterName=watch_6, value=code_block_33)

watch_7 = Watch(code_block_13.out3)

# group: Set one value to yes
code_block_34 = CodeBlock { 1; }
setParameterByName_10 = Element.SetParameterByName(parameterName=watch_7, value=code_block_34)

watch_8 = Watch(watch_4)

# group: Bool mask for plan 8-9
code_block_35 = CodeBlock { 8..9; }
containsItem_4 = List.ContainsItem(item=code_block_35)
map_8 = List.Map(list=filterByBoolMask.out, f_x=containsItem_4)
anyTrue_4 = Custom[List.AnyTrue]()
map_9 = List.Map(list=map_8, f_x=anyTrue_4)

filterByBoolMask_8 = List.FilterByBoolMask(list=watch_4, mask=map_9)
watch_9 = Watch(filterByBoolMask_8.in)
