# Dynamo graph quickSheets.dyn (Dynamo 0.9.0.3067)

code_block = CodeBlock {  }
code_block_2 = CodeBlock { "Tr "; }
code_block_3 = CodeBlock { 3..10; }
code_block_4 = CodeBlock(a=code_block_2, b=code_block_3) { a+b; }
code_block_5 = CodeBlock { " - Plan "; }
code_block_6 = CodeBlock(a=code_block_4, b=code_block_5) { a+b; }
code_block_7 = CodeBlock { {18, 16, 17, 18, 17, 19, 20, 20}; }
code_block_8 = CodeBlock(a=code_block_6, b=code_block_7) { a+b; }
code_block_9 = CodeBlock { " - Vind"; }
code_block_10 = CodeBlock(a=code_block_8, b=code_block_9) { a+b; }
code_block_11 = CodeBlock { "A-40-1-"; }
code_block_12 = CodeBlock { 3; 10; }
python_script = Python(IN[0]=code_block_12.out0, IN[1]=code_block_12.out1)
# ---------- python_script.python (13 lines) ----------
import clr
clr.AddReference('ProtoGeometry')
from Autodesk.DesignScript.Geometry import *
#The inputs to this node will be stored as a list in the IN variables.
dataEnteringNode = IN

start = IN[0]
stop = IN[1]

OUT = []

for i in range(start, stop+1):
	OUT.append('{:02d}'.format(i))
# ----------------------------------------
code_block_13 = CodeBlock(a=code_block_11, b=python_script) { a+b; }
code_block_14 = CodeBlock(a=code_block_13, b=code_block_7) { a+b; }
code_block_15 = CodeBlock { "SVB3 A1 JM"; }
byName = FamilyType.ByName(code_block_15)
views = Views("Dummy")
byNameNumberTitleBlockAndView = Sheet.ByNameNumberTitleBlockAndView(sheetName=code_block_10, sheetNumber=code_block_14, titleBlockFamilyType=byName, view=views)
code_block_16 = CodeBlock { null; }
code_block_17 = CodeBlock { "Dummy"; }
filterByName = Custom[Elements.FilterByName](searchString=code_block_17)  # Retrieves those elements from a collection whose names match the search string
code_block_18 = CodeBlock { 0; }
getItemAtIndex = List.GetItemAtIndex(list=filterByName.out, index=code_block_18)
