# Dynamo graph renumberSheets.dyn (Dynamo 0.9.0.3067)

code_block = CodeBlock { "SHEET_NUMBER"; }
code_block_2 = CodeBlock { "OST_Sheets"; }
byName = Category.ByName(code_block_2)
all_elements_of_category = ElementsOfCategory(byName)

# group: Top: expression to match Bottom: expression to replace with
code_block_3 = CodeBlock { "A-(4\d)\.(\d)-(\d{3})"; }
code_block_4 = CodeBlock { "A-\1-\2-0\3"; }

sheetNumber = Sheet.SheetNumber(all_elements_of_category)
matchRegularExpression = Custom[String.MatchRegularExpression](RegEx=code_block_3, str=sheetNumber)  # Determines if a regular expression matches a string (or a list of strings) and returns a boolean value (or a list, depending on the input). The syntax for regular expressions is explained at http://ironpython-test.readthedocs.org/en/latest/howto/regex.html
filterByBoolMask = List.FilterByBoolMask(list=all_elements_of_category, mask=matchRegularExpression)
watch = Watch(filterByBoolMask.in)
filterByBoolMask_2 = List.FilterByBoolMask(list=sheetNumber, mask=matchRegularExpression)
replaceRegularExpression = Custom[String.ReplaceRegularExpression](RegEx=code_block_3, str=filterByBoolMask_2.in, Replacement=code_block_4)  # Replaces all occurences of a regular expression within a given string (or list of strings) with another string. The syntax for regular expressions is explained at http://ironpython-test.readthedocs.org/en/latest/howto/regex.html
set_builtin_parameter = Custom[Set BuiltIn Parameter](ParameterName=code_block, Elements=watch, ParameterValues=replaceRegularExpression)  # This node will take an input of a built in parameter name and set that parameter to given value for given elements.
