# Dynamo graph setPreliminaryDocument.dyn (Dynamo 1.0.0.1180)

code_block = CodeBlock { "OST_Sheets"; }
byName = Category.ByName(code_block)
all_elements_of_category = ElementsOfCategory(byName)
watch = Watch(all_elements_of_category)
code_block_2 = CodeBlock { "sweco_Drawing Status"; }
getParameterValueByName = Element.GetParameterValueByName(element=all_elements_of_category, parameterName=code_block_2)
code_block_3 = CodeBlock(A=getParameterValueByName) { A == "BYGGHANDLING"; }
filterByBoolMask = List.FilterByBoolMask(list=all_elements_of_category, mask=code_block_3)
code_block_4 = CodeBlock { "Sheet Issue Date"; "160525"; "Preliminärt dokument"; 1; }
setParameterByName = Element.SetParameterByName(element=filterByBoolMask.in, parameterName=code_block_4.out0, value=code_block_4.out1)
code_block_5 = CodeBlock { "OST_TitleBlocks"; }
byName_2 = Category.ByName(code_block_5)
all_elements_of_category_2 = ElementsOfCategory(byName_2)
filterByBoolMask_2 = List.FilterByBoolMask(list=all_elements_of_category_2, mask=code_block_3)
setParameterByName_2 = Element.SetParameterByName(element=filterByBoolMask_2.in, parameterName=code_block_4.out2, value=code_block_4.out3)
code_block_6 = CodeBlock { "Sheet Number"; }
getParameterValueByName_2 = Element.GetParameterValueByName(element=filterByBoolMask.in, parameterName=code_block_6)
