# Dynamo graph switchSheetNameAndNumber.dyn (Dynamo 0.9.1.4062)

categories = Categories("Sheets")
all_elements_of_category = ElementsOfCategory(categories)
code_block = CodeBlock { 0; }
getItemAtIndex = List.GetItemAtIndex(list=all_elements_of_category, index=code_block)
get_builtinparameter_name = ItemSelector("Sheet Number | SHEET_NUMBER | string | ReadWrite", getItemAtIndex)
element_name_universal = Custom[Element.Name (Universal)](element=all_elements_of_category)  # Gets an element's name (Dynamo's built-in Name nodes don't work for all element types, e.g. worksets...)
code_block_2 = CodeBlock { "SHEET_NAME"; }
code_block_3 = CodeBlock { "A-40-1-\d{3}"; }
code_block_4 = CodeBlock { "SHEET_NAME"; }
get_built_in_parameter = Custom[Get Built In Parameter](ParameterNames=code_block_4, Elements=all_elements_of_category)  # This node will take an input of a built in parameter name and element to return that parameters value.
matchRegularExpression = Custom[String.MatchRegularExpression](RegEx=code_block_3, str=get_built_in_parameter)  # Determines if a regular expression matches a string (or a list of strings) and returns a boolean value (or a list, depending on the input). The syntax for regular expressions is explained at http://ironpython-test.readthedocs.org/en/latest/howto/regex.html
filterByBoolMask = List.FilterByBoolMask(list=all_elements_of_category, mask=matchRegularExpression)
code_block_5 = CodeBlock { "SHEET_NUMBER"; }
get_built_in_parameter_2 = Custom[Get Built In Parameter](ParameterNames=code_block_5, Elements=all_elements_of_category)
filterByBoolMask_2 = List.FilterByBoolMask(list=get_built_in_parameter_2, mask=matchRegularExpression)
watch = Watch(filterByBoolMask_2.in)
set_builtin_parameter = Custom[Set BuiltIn Parameter](ParameterName=code_block_2, Elements=filterByBoolMask.in, ParameterValues=watch)  # This node will take an input of a built in parameter name and set that parameter to given value for given elements.
count = Count(filterByBoolMask_2.in)
code_block_6 = CodeBlock { "Temp"; }
python_script = Python(IN[0]=count, IN[1]=code_block_6)
# ---------- python_script.python (12 lines) ----------
import clr
clr.AddReference('ProtoGeometry')
from Autodesk.DesignScript.Geometry import *
#The inputs to this node will be stored as a list in the IN variables.
dataEnteringNode = IN

OUT = []
for i in range(IN[0]):
	OUT.append(IN[1] + " {0}".format(i))
	

#Assign your output to the OUT variable.
# ----------------------------------------
watch_2 = Watch(python_script)
code_block_7 = CodeBlock { "SHEET_NUMBER"; }
filterByBoolMask_3 = List.FilterByBoolMask(list=get_built_in_parameter, mask=matchRegularExpression)
watch_3 = Watch(filterByBoolMask_3.in)
set_builtin_parameter_2 = Custom[Set BuiltIn Parameter](ParameterName=code_block_7, Elements=filterByBoolMask.in, ParameterValues=watch_3)
