# Dynamo graph webSheet.dyn (Dynamo 1.0.0.1180)

code_block = CodeBlock { "http://localhost:8090/api"; }
web_request = WebRequest(code_block)
watch = Watch(web_request)
python_script = Python(IN[0]=web_request)
# ---------- python_script.python (31 lines) ----------
import clr
clr.AddReference('ProtoGeometry')
from Autodesk.DesignScript.Geometry import *
#The inputs to this node will be stored as a list in the IN variables.
import sys

sys.path.append('C:\Program Files (x86)\IronPython 2.7\Lib')

import json

obj = json.loads(IN[0])

debug = []

stdsave = sys.stdout
fout = open(r'C:\Users\seregn\output.txt','w')
sys.stdout = fout

asd = IN[0]

print('type: ' + str(type(asd)) + ' str: ' + str(asd) + ' dir: ' + str(dir(asd)))

sys.stdout = stdsave
fout.close()

debug.append(type(IN[0]))
debug.append(str(IN[0]))
debug.append(dir(IN[0]))

#Assign your output to the OUT variable.
OUT = debug
# ----------------------------------------
watch_2 = Watch(python_script)
