# Dynamo custom node Find Symbol In Sheets.dyf (Dynamo 0.9.0.3067)
# category: Sweco.Sheets
# A node to find all occurances of a given symbol family type. The node will process all sheets with sheet numbers matching the regEx input.

RegEx = Input(RegEx : string)
Family_Type = Input()
all_elements_of_family_type = ElementsOfFamilyType(Family_Type)
workset = Custom[Element.Workset](element=all_elements_of_family_type)  # Retrieves the workset of a given element
element_name_universal = Custom[Element.Name (Universal)](element=workset)  # Gets an element's name (Dynamo's built-in Name nodes don't work for all element types, e.g. worksets...)
findRegularExpression = Custom[String.FindRegularExpression](RegEx=RegEx, str=element_name_universal)  # Returns all occurences of a regular expression within a string (or list of strings). The syntax for regular expressions is explained at http://ironpython-test.readthedocs.org/en/latest/howto/regex.html
seq = Output(findRegularExpression)
Elements = Output(all_elements_of_family_type)
