# Dynamo graph openingAreaPerWallType.dyn (Dynamo 0.9.1.4062)

categories = Categories("Windows")
all_elements_of_category = ElementsOfCategory(categories)
code_block = CodeBlock { "dyn_InWallType"; }
host = Custom[Element.Host](element=all_elements_of_category)  # Gets an element's host
type = Custom[Element.Type](element=host)  # Gets the family type of a given element (if applicable).
code_block_2 = CodeBlock { "Type Comments"; }
getParameterValueByName = Element.GetParameterValueByName(element=type, parameterName=code_block_2)
setParameterByName = Element.SetParameterByName(element=all_elements_of_category, parameterName=code_block, value=getParameterValueByName)
categories_2 = Categories("Doors")
all_elements_of_category_2 = ElementsOfCategory(categories_2)
name = Element.Name(all_elements_of_category_2)
code_block_3 = CodeBlock { "Door plan"; }
eq = name == code_block_3
filterByBoolMask = List.FilterByBoolMask(list=all_elements_of_category_2, mask=eq)
code_block_4 = CodeBlock { "dyn_InWallType"; }
host_2 = Custom[Element.Host](element=filterByBoolMask.out)
type_2 = Custom[Element.Type](element=host_2)
code_block_5 = CodeBlock { "Type Comments"; }
getParameterValueByName_2 = Element.GetParameterValueByName(element=type_2, parameterName=code_block_5)
setParameterByName_2 = Element.SetParameterByName(element=filterByBoolMask.out, parameterName=code_block_4, value=getParameterValueByName_2)
