# Dynamo graph windowArea.dyn (Dynamo 0.9.1.4062)

categories = Categories("Windows")
all_elements_of_category = ElementsOfCategory(categories)
code_block = CodeBlock { "dyn_InWallType"; }
host = Custom[Element.Host](element=all_elements_of_category)  # Gets an element's host
type = Custom[Element.Type](element=host)  # Gets the family type of a given element (if applicable).
code_block_2 = CodeBlock { "Type Comments"; }
getParameterValueByName = Element.GetParameterValueByName(element=type, parameterName=code_block_2)
setParameterByName = Element.SetParameterByName(element=all_elements_of_category, parameterName=code_block, value=getParameterValueByName)
