# Dynamo graph quickDependentViews.dyn (Dynamo 0.9.1.4062)

boolean = BoolSelector(false)
views = Custom[Document.Views](toggle=boolean)  # Gets all views in the document - except for 3D view templates (as long as this bug is not fixed: https://github.com/DynamoDS/Dynamo/issues/2970)
code_block = CodeBlock(allViews=views) { allViews; }
code_block_2 = CodeBlock { "dyn_Filter"; }
getParameterValueByName = Element.GetParameterValueByName(element=code_block, parameterName=code_block_2)
code_block_3 = CodeBlock { 0; 1; }
eq = getParameterValueByName == code_block_3.out1
filterByBoolMask = List.FilterByBoolMask(list=code_block, mask=eq)
setParameterByName = Element.SetParameterByName(element=filterByBoolMask.in, parameterName=code_block_2, value=code_block_3.out0)
code_block_4 = CodeBlock { "VIEW_NAME"; }
set_builtin_parameter = Custom[Set BuiltIn Parameter](ParameterName=code_block_4)  # This node will take an input of a built in parameter name and set that parameter to given value for given elements.
getParameterValueByName_2 = Element.GetParameterValueByName(element=views, parameterName=code_block_2)
groupByKey = List.GroupByKey(keys=getParameterValueByName_2)
code_block_5 = CodeBlock { 0; 1; }
indexOf = IndexOf(groupByKey.unique_keys, code_block_5.out1)
getItemAtIndex = List.GetItemAtIndex(list=groupByKey.groups, index=indexOf)
code_block_6 = CodeBlock { 9; }
ofRepeatedItem = List.OfRepeatedItem(amount=code_block_6)
map = List.Map(list=getItemAtIndex, f_x=ofRepeatedItem)
duplicateAsDependent = Custom[View.DuplicateAsDependent]()  # Duplicates a given view as a dependent view
map_2 = List.Map(list=map, f_x=duplicateAsDependent)
element_name_universal = Custom[Element.Name (Universal)](element=getItemAtIndex)  # Gets an element's name (Dynamo's built-in Name nodes don't work for all element types, e.g. worksets...)
code_block_7 = CodeBlock { " - Trh "; }
concat = String.Concat(arg1=code_block_7)
map_3 = List.Map(list=element_name_universal, f_x=concat)
code_block_8 = CodeBlock(x=code_block_6) { 1..x; }
string_from_object = FromObject(code_block_8)
code_block_9 = CodeBlock(x=map_3, y=string_from_object) { x<1> + y<2>; }
combine = List.Combine(set_builtin_parameter, map_2, code_block_9)
