# Dynamo graph regexRenameViews.dyn (Dynamo 0.9.1.4062)

views = Custom[Document.Views]()  # Gets all views in the document - except for 3D view templates (as long as this bug is not fixed: https://github.com/DynamoDS/Dynamo/issues/2970)
code_block = CodeBlock { "^SH -"; }
element_name_universal = Custom[Element.Name (Universal)](element=views)  # Gets an element's name (Dynamo's built-in Name nodes don't work for all element types, e.g. worksets...)
matchRegularExpression = Custom[String.MatchRegularExpression](RegEx=code_block, str=element_name_universal)  # Determines if a regular expression matches a string (or a list of strings) and returns a boolean value (or a list, depending on the input). The syntax for regular expressions is explained at http://ironpython-test.readthedocs.org/en/latest/howto/regex.html
filterByBoolMask = List.FilterByBoolMask(list=views, mask=matchRegularExpression)
code_block_2 = CodeBlock { "(^SH)(.*)"; "BH\2"; }
element_name_universal_2 = Custom[Element.Name (Universal)](element=filterByBoolMask.in)
replaceRegularExpression = Custom[String.ReplaceRegularExpression](RegEx=code_block_2.out0, str=element_name_universal_2, Replacement=code_block_2.out1)  # Replaces all occurences of a regular expression within a given string (or list of strings) with another string. The syntax for regular expressions is explained at http://ironpython-test.readthedocs.org/en/latest/howto/regex.html
setName = Custom[Element.SetName](element=filterByBoolMask.in, name=replaceRegularExpression)  # Gets the name of a given Revit element
